# Dynamo graph Get Model Elements Data (Excel export).dyn (Dynamo 2.3.1.11775)
# packages: archi-lab.net 2021.25.2621, bimorphNodes 3.0.3, Data-Shapes 2021.2.92, Clockwork for Dynamo 2.x 2.3.0

# group: SET TRUE FOR LINK AND FALSE FOR ACTIVE DOCUMENT
run_script_for_linked_file = BoolSelector(false)  # graph input

# group: PORTION OF SCRIPT THAT WORKS WITH LINKED DOCUMENTS
string = StringInput("Finish")
string_2 = StringInput("Select Categories")
string_3 = StringInput("Cancel")
string_4 = StringInput("Finish")
string_5 = StringInput("Select Linked File")
getDocuments = archilab.Revit.Selection.Select.GetDocuments()
dropdown_data = Custom[DropDown Data](InputName=string_5, Keys=getDocuments.Link_Name, Values=getDocuments.Link_Instance)  # package Data-Shapes; Create data for DropDown input in UI.MultiInputForm ++ . Check out www.data-shapes.net for more infos.
string_6 = StringInput("Cancel")
multipleinputform = Custom[MultipleInputForm ++](Logo_optional=run_script_for_linked_file, ButtonText_optional=string_4, Inputs=dropdown_data, Toggle=run_script_for_linked_file, CancelButtonText_optional=string_6)  # package Data-Shapes; Create a form with multiple inputs. see www.data-shapes.net for tutorials and infos!
code_block = CodeBlock(x=multipleinputform.User_Inputs) { x[0]; }
getAll = archilab.Revit.Elements.Categories.GetAll()
ofCategory = Revit.LinkElement.OfCategory(linkInstance=code_block, category=getAll.Model)
boolean = BoolSelector(false)
clean = List.Clean(list=ofCategory, preserveIndices=boolean)
element = Revit.LinkElement.Element(linkElement=clean)
getCategory = Element.GetCategory(element=element)
uniqueItems = List.UniqueItems()  # unwired: list
map = List.Map(list=getCategory, f_x=uniqueItems)
flatten = List.Flatten(list=map)
string_from_object = FromObject(obj=flatten)
categories_as_strings_you_don_t = CodeBlock()  # "Categories (As Strings) you don't want to see in Selection Interface!"
# ---------- categories_as_strings_you_don_t.designscript (3 lines) ----------
["HVAC Zones", "Materials", "Pipe Segments", "Project Information",
"RVT Links", "Array", "Topography", "Views", "Section Boxes",
"Site", "Load", "Level", "Elevation", "Line"];
# ----------------------------------------
contains = String.Contains(str=string_from_object, searchFor=categories_as_strings_you_don_t, lacing=CrossProduct)
boolean_2 = BoolSelector(true)
contains_2 = List.Contains(list=contains@L2, item=boolean_2)
boolean_3 = BoolSelector(false)
allIndicesOf = List.AllIndicesOf(list=contains_2, item=boolean_3)
getItemAtIndex = List.GetItemAtIndex(list=flatten, index=allIndicesOf)
listview_data = Custom[Listview Data](InputName=string_2, Keys=getItemAtIndex, Values=getItemAtIndex)  # package Data-Shapes; Create data for ListView input in UI.MultiInputForm ++ . Check out www.data-shapes.net for more infos.
multipleinputform_2 = Custom[MultipleInputForm ++](Logo_optional=run_script_for_linked_file, ButtonText_optional=string, Inputs=listview_data, Toggle=run_script_for_linked_file, CancelButtonText_optional=string_3)
code_block_2 = CodeBlock(x=multipleinputform_2.User_Inputs) { x[0]; }

builtInCategories = Custom[Document.BuiltInCategories]()  # package Clockwork for Dynamo 2.x; List all the available BuiltInCategories
all_elements_of_category = ElementsOfCategory(Category=builtInCategories.Categories)
boolean_4 = BoolSelector(false)
clean_2 = List.Clean(list=all_elements_of_category, preserveIndices=boolean_4)

# group: PORTION OF SCRIPT THAT WORKS WITH CURRENT DOCUMENT
all_elements_in_active_view = ElementsInView()
getCategory_2 = Element.GetCategory(element=clean_2)
uniqueItems_2 = List.UniqueItems(list=getCategory_2@L2)
flatten_2 = List.Flatten(list=uniqueItems_2)
string_from_object_2 = FromObject(obj=flatten_2)
categories_as_strings_you_don_t_2 = CodeBlock()  # "Categories (As Strings) you don't want to see in Selection Interface!"; same code as categories_as_strings_you_don_t
contains_3 = String.Contains(str=string_from_object_2, searchFor=categories_as_strings_you_don_t_2, lacing=CrossProduct)
boolean_5 = BoolSelector(true)
contains_4 = List.Contains(list=contains_3@L2, item=boolean_5)
boolean_6 = BoolSelector(false)
allIndicesOf_2 = List.AllIndicesOf(list=contains_4, item=boolean_6)
getItemAtIndex_2 = List.GetItemAtIndex(list=uniqueItems_2, index=allIndicesOf_2)
flatten_3 = List.Flatten(list=getItemAtIndex_2)
listview_data_2 = Custom[Listview Data](InputName=string_2, Keys=flatten_3, Values=flatten_3)
boolean_7 = BoolSelector(false)
boolean_8 = BoolSelector(true)
if_ = If(test=run_script_for_linked_file, true=boolean_7, false=boolean_8)
multipleinputform_3 = Custom[MultipleInputForm ++](Logo_optional=run_script_for_linked_file, ButtonText_optional=string, Inputs=listview_data_2, Toggle=if_, CancelButtonText_optional=string_3)

# group: REARRANGE DATA FOR EXCEL EXPORT (ACTIVE DOCUMENT)
all_elements_of_category_2 = ElementsOfCategory(Category=multipleinputform_3.User_Inputs)
name = FamilyType.Name(familyType=all_elements_of_category_2)
uniqueItems_3 = List.UniqueItems(list=name@L2)

# group: LIST OF ALL REVIT CATEGORIES AND FAMILY TYPES MODELLED IN THE DOCUMENT (ACTIVE DOCUMENT)
code_block_3 = CodeBlock(x=multipleinputform_3.User_Inputs) { x[0]; }
list_create = List.Create(item0=code_block_3, item1=uniqueItems_3)
transpose = List.Transpose(lists=list_create)
code_block_4 = CodeBlock { -2; }
flatten_4 = List.Flatten(amt=code_block_4)  # unwired: list
map_2 = List.Map(list=transpose, f_x=flatten_4)
transpose_2 = List.Transpose(lists=map_2)

# group: REARRANGE DATA FOR EXCEL EXPORT (LINKED DOCUMENT)
ofCategory_2 = Revit.LinkElement.OfCategory(linkInstance=code_block, category=multipleinputform_2.User_Inputs)
name_2 = FamilyType.Name(familyType=ofCategory_2)
uniqueItems_4 = List.UniqueItems(list=name_2@L2)

# group: LIST OF ALL REVIT CATEGORIES AND FAMILY TYPES MODELLED IN THE DOCUMENT (LINKED DOCUMENT)
list_create_2 = List.Create(item0=code_block_2, item1=uniqueItems_4)
transpose_3 = List.Transpose(lists=list_create_2)
code_block_5 = CodeBlock { -2; }
flatten_5 = List.Flatten(amt=code_block_5)  # unwired: list
map_3 = List.Map(list=transpose_3, f_x=flatten_5)
transpose_4 = List.Transpose(lists=map_3)

# group: ALL DOCUMENT DATA == EXCEL EXPORT
excel_file_path_that_receives = Filename("..\Excel Files\All Model Elements.xlsx")  # "Excel File Path that receives the Model Data"; graph input
sheet_name = StringInput("Architectural")  # graph input
code_block_6 = CodeBlock { 0; }
python_script = Python(IN[0]=run_script_for_linked_file, IN[1]=transpose_2, IN[2]=transpose_4)
# ---------- python_script.python (23 lines) ----------
# Load the Python Standard and DesignScript Libraries
import sys
import clr
clr.AddReference('ProtoGeometry')
from Autodesk.DesignScript.Geometry import *

# The inputs to this node will be stored as a list in the IN variables.
dataEnteringNode = IN

# Place your code below this line
test = IN[0]
doc = IN[1]
link = IN[2]

output = []

if test == True:
	output.append(link)
else:
	output.append(doc)

# Assign your output to the OUT variable.
OUT = output[0]
# ----------------------------------------
overwrite_excel_data = BoolSelector(true)  # graph input
exportExcel = Data.ExportExcel(filePath=excel_file_path_that_receives, sheetName=sheet_name, startRow=code_block_6, startCol=code_block_6, data=python_script, overWrite=overwrite_excel_data)  # frozen

byName = Category.ByName(name=builtInCategories.Categories)
python_script_2 = Python()  # unwired: IN[0]
# ---------- python_script_2.python (17 lines) ----------
import clr

clr.AddReference('RevitAPI')
from Autodesk.Revit.DB import *

clr.AddReference('RevitServices')
import RevitServices
from RevitServices.Persistence import DocumentManager
from RevitServices.Transactions import TransactionManager

doc = DocumentManager.Instance.CurrentDBDocument

All_Element_filter = FilteredElementCollector( doc )
All_Element_filter = All_Element_filter.WherePasses(LogicalOrFilter(ElementIsElementTypeFilter( False ),ElementIsElementTypeFilter( True )))
FilteredElementCollector

OUT = All_Element_filter.ToElements()
# ----------------------------------------
getCategory_3 = Element.GetCategory(element=python_script_2)
boolean_9 = BoolSelector(true)
python_script_3 = Python(IN[0]=boolean_9)
# ---------- python_script_3.python (17 lines) ----------
import clr
import System
clr.AddReference('RevitAPI')
clr.AddReference('RevitAPIUI')
from Autodesk.Revit.DB import *
import Autodesk
clr.AddReference("RevitNodes")
import Revit

dynamoCatsOnly = IN[0]
biclist = System.Enum.GetValues(BuiltInCategory)
cdata = []
for bic in biclist:
	try: cdata.append((bic, ElementId(bic), Revit.Elements.Category.ById(ElementId(bic).IntegerValue)))
	except:
		if not dynamoCatsOnly: cdata.append((bic, ElementId(bic), None))
OUT = map(list, zip(*cdata))
# ----------------------------------------
python_script_4 = Python(IN[0]=builtInCategories.BuiltInCategories)
# ---------- python_script_4.python (19 lines) ----------
# Load the Python Standard and DesignScript Libraries
import sys
import clr
import System
clr.AddReference('RevitAPI')
clr.AddReference('RevitAPIUI')
from Autodesk.Revit.DB import *
import Autodesk
clr.AddReference("RevitNodes")
import Revit


# The inputs to this node will be stored as a list in the IN variables.
Elems = UnwrapElement(IN[0])

# Place your code below this line

# Assign your output to the OUT variable.
OUT = ElementId(Elems)
# ----------------------------------------
